# Grasshopper definition Hops_endpoint_example.gh (Grasshopper 1.0.8)
# plug-ins: Hops

# ---- group: Geometry
brep = Brep([<brep referenced from the Rhino model> x5])

# ---- group: Extract object height
bbox = BoundingBox(Content=brep, Plane=PlaneXY(0, 0, 0))  # -> Box, Box_2
debox = DeconstructBox(Box=bbox.Box)  # -> Plane, X, Y, Z
dedomain = DeconstructDomain(Domain=debox.Z)  # -> Start, End
max = Maximum(A=dedomain.Start, B=dedomain.End)  # -> flatten(Result)

# ---- group: Assign colors
merge = Merge(
    Data1=ColourSwatch(SwatchColor=RGB(255, 163, 77)),
    Data2=ColourSwatch(SwatchColor=RGB(255, 115, 255)),
    Data3=ColourSwatch(SwatchColor=RGB(140, 255, 255)),
    Data4=ColourSwatch(SwatchColor=RGB(255, 255, 126)),
    Data5=ColourSwatch(SwatchColor=RGB(140, 255, 126)))
preview = CustomPreview(Geometry=brep, Material=merge)

# ---- group: geometry
panel = Panel(brep)

# ---- group: Color(Text)
panel_2 = Panel(merge)

# ---- group: Obj Name (Title)
panel_3 = Panel("""Donut
SmallCube
Xshape
Triangle
LargeCube""")

# ---- group: Number(Num)
panel_4 = Panel(max)

# ---- group: Tag (Select)
panel_5 = Panel("""Big
Small
Big
Small
Medium""")

# ----
hops = Hops(
    Name=panel_3,
    Color=panel_2,
    Number=panel_4,
    Tag=panel_5,
    Trigger=Toggle(True),
    CacheResultsInMemory=False,
    CacheSolveResults=False,
    RemoteDefinitionLocation="http://127.0.0.1:5000/post_to_notion",
    RemoteSolveVersion=(0, 1, 0),
    ShowInput_Enabled=False,
    ShowInput_Path=False,
    SynchronousSolve=True)
panel_6 = Panel(hops)
