# Grasshopper definition Rhino2Notion-Example.gh (Grasshopper 1.0.8)
# plug-ins: Hops

brep = Brep([<brep referenced from the Rhino model> x5])

merge = Merge(
    Data1=ColourSwatch(SwatchColor=RGB(0, 0, 255)),
    Data2=ColourSwatch(SwatchColor=RGB(255, 115, 255)),
    Data3=ColourSwatch(SwatchColor=RGB(140, 255, 255)),
    Data4=ColourSwatch(SwatchColor=RGB(255, 255, 126)),
    Data5=ColourSwatch(SwatchColor=RGB(140, 255, 126)))
preview = CustomPreview(Geometry=brep, Material=merge)

# ---- group: Extract object height
bbox = BoundingBox(Content=brep, Plane=PlaneXY(0, 0, 0))  # -> Box, Box_2
debox = DeconstructBox(Box=bbox.Box)  # -> Plane, X, Y, Z
dedomain = DeconstructDomain(Domain=debox.Z)  # -> Start, End
max = Maximum(A=dedomain.Start, B=dedomain.End)

# ---- group: geometry
panel = Panel(brep)

# ---- group: Text
panel_2 = Panel("""Donut
Small_Cube
Large_Cube
Triangle
X_Shape""")

# ---- group: Color
panel_3 = Panel(merge)

# ---- group: Number
panel_4 = Panel(max)

# ---- group: Tag
panel_5 = Panel("""Big
Small
Big
Small
Medium""")

# ----
hops = Hops(
    CacheResultsInMemory=True,
    CacheSolveResults=True,
    RemoteSolveVersion=(0, 1, 0),
    ShowInput_Enabled=False,
    ShowInput_Path=False,
    SynchronousSolve=True)
